# Grasshopper definition LA2.gh (Grasshopper 1.0.7)

minradius = Slider(10, range=0..15)
number_slider = Slider(1, range=0..10)
python = GhPythonScript(x=Slider(0, range=0..20), numCircles=number_slider, y=Slider(0, range=0..20), minRadius=minradius)  # -> out, pts, circles
# ---------- python: Python ----------
__author__ = "smont"

import rhinoscriptsyntax as rs
from random import random

a = rs.AddPoint((x,y,0))

startX = x
startY = y
startZ = 0
circleNum = int(numCircles)

pts = []
circles = []

# Create points
for i in range(0, circleNum):
    for j in range(0, circleNum):
        newX = startX + i * 15
        newY = startY + j * 15
        pts.append(rs.AddPoint(newX, newY, startZ))
    

plane = rs.WorldXYPlane()

for pt in pts:
    circles.append(rs.AddCircle(pt, minRadius))
# ---------- end python ----------
number_slider_2 = Slider(35, range=5..40)
python_2 = GhPythonScript(x=Slider(3, range=-20..20), y=Slider(7, range=-20..40), z=number_slider_2, numCircles=number_slider, minRadius=minradius)  # -> out, pts, circles
# ---------- python_2: Python ----------
__author__ = "smont"

import rhinoscriptsyntax as rs
from random import random

a = rs.AddPoint((x,y,z))

startX = x
startY = y
startZ = z
circleNum = int(numCircles)

pts = []
circles = []

# Create points
for i in range(0, circleNum):
    for j in range(0, circleNum):
        newX = startX + i * 15
        newY = startY + j * 15
        pts.append(rs.AddPoint(newX, newY, startZ))
    

for pt in pts:
    circles.append(rs.AddCircle(pt, minRadius))
# ---------- end python_2 ----------
vec = VectorXYZ(XComponent=Slider(-20, range=-20..20), YComponent=Slider(-20, range=-20..20), ZComponent=Slider(36, range=5..50))  # -> Vector, Length
srf = Surface(python_2.circles)
srf_2 = Surface(python.circles)
vec_2 = VectorXYZ(XComponent=Slider(20, range=0..20), YComponent=Slider(0, range=0..20), ZComponent=number_slider_2)  # -> Vector, Length
extr = Extrude(Base=srf, Direction=vec.Vector)
extr_2 = Extrude(Base=srf_2, Direction=vec_2.Vector)
cap = CapHoles(Brep=extr)
cap_2 = CapHoles(Brep=extr_2)
sunion = SolidUnion(Breps=cap_2)
sunion_2 = SolidUnion(Breps=cap)
bbox = BoundingBox(Content=sunion, Plane=PlaneXY(0, 0, 0))  # -> Box, Box_2
bbox_2 = BoundingBox(Content=sunion_2, Plane=PlaneXY(0, 0, 0))  # -> Box, Box_2
geo = Geometry(sunion_2)
debox = DeconstructBox(Box=bbox.Box)  # -> Plane, X, Y, Z
area = Area(Geometry=bbox.Box)  # -> Area, Centroid
debox_2 = DeconstructBox(Box=bbox_2.Box)  # -> Plane, X, Y, Z
area_2 = Area(Geometry=bbox_2.Box)  # -> Area, Centroid
pt = Point(area.Centroid)
dedomain = DeconstructDomain(Domain=debox.Z)  # -> Start, End
devec = DeconstructVector(Vector=pt)  # -> XComponent, YComponent, ZComponent
pt_2 = Point(area_2.Centroid)
dedomain_2 = DeconstructDomain(Domain=debox_2.Z)  # -> Start, End
vec_3 = VectorXYZ(XComponent=devec.XComponent, YComponent=devec.YComponent, ZComponent=dedomain.Start)  # -> Vector, Length
vec_4 = VectorXYZ(XComponent=devec.XComponent, YComponent=devec.YComponent, ZComponent=dedomain.End)  # -> Vector, Length
devec_2 = DeconstructVector(Vector=pt_2)  # -> XComponent, YComponent, ZComponent
ln = Line(StartPoint=vec_3.Vector, EndPoint=vec_4.Vector)
geo_2 = Geometry(sunion)
vec_5 = VectorXYZ(XComponent=devec_2.XComponent, YComponent=devec_2.YComponent, ZComponent=dedomain_2.End)  # -> Vector, Length
vec_6 = VectorXYZ(XComponent=devec_2.XComponent, YComponent=devec_2.YComponent, ZComponent=dedomain_2.Start)  # -> Vector, Length
twist = Twist(Geometry=geo_2, Axis=ln, Angle=Slider(8.637, range=0..20), Infinite=False, Rigid=False)
debrep = DeconstructBrep(Brep=twist)  # -> Faces, Edges, Vertices
ln_2 = Line(StartPoint=vec_6.Vector, EndPoint=vec_5.Vector)
twist_2 = Twist(Geometry=geo, Axis=ln_2, Angle=Slider(8.415, range=0..20), Infinite=False, Rigid=False)
contour = Contour(Shape=debrep.Faces, Point=Point(0, 0, 0), Direction=Vector(0, 0, 1), Distance=Slider(3, range=0..10))
debrep_2 = DeconstructBrep(Brep=twist_2)  # -> Faces, Edges, Vertices
contour_2 = Contour(Shape=debrep_2.Faces, Point=Point(0, 0, 0), Direction=Vector(0, 0, 1), Distance=Slider(3, range=0..10))
